# Grasshopper definition cabinet2.gh (Grasshopper 0.9.76)
# plug-ins: Python Interpreter, Wombat, Telepathy

panel = Panel("""48
18
18""")
bang = ExplodeTree(Data=simplify(graft(panel)))  # -> Branch0, Branch1, Branch2
panel_2 = Panel("6")
box = DomainBox(Base=PlaneXY(0, 0, 0), X=bang.Branch0, Y=bang.Branch1, Z=bang.Branch2)
list = ValueList({"1/4": .25, "1/2": .5, "3/4": .75, "6mm": .236, "12mm": .472}, selected="1/4")
list_2 = ValueList({"1/4": .25, "1/2": .5, "3/4": .75, "6mm": .236, "12mm": .472}, selected="3/4")
list_3 = ValueList({"1/4": .25, "1/2": .5, "3/4": .75, "6mm": .236, "12mm": .472}, selected="3/4")
list_4 = ValueList({"1/4": .25, "1/2": .5, "3/4": .75, "6mm": .236, "12mm": .472}, selected="1/4")
list_5 = ValueList({"1/4": .25, "3/8": .375, "1/2": .5, "3/4": .75, "6mm": .236, "12mm": .472}, selected="1/2")
list_6 = ValueList({"1/4": .25, "3/8": .375, "1/2": .5, "3/4": .75, "6mm": .236, "12mm": .472}, selected="3/4")
list_7 = ValueList({"1/4": .25, "3/8": .375, "1/2": .5, "3/4": .75, "6mm": .236, "12mm": .472}, selected="3/8")
list_8 = ValueList({"1/4": .25, "3/8": .375, "1/2": .5, "3/4": .75, "6mm": .236, "12mm": .472}, selected="1/2")
python = PythonScript(
    b=box,
    caseThickness=list_3,
    tenonThickness=list_4,
    mortiseDepth=list_5,
    backThickness=list_6,
    divisions="2",
    adjustableShelves=Toggle(True))  # -> out, top, bottom, left, right, back, dividers; inputs b: Brep, divisions: Int32, adjustableShelves: Boolean
# ---------- python: Python ----------
import Rhino as r
import Rhino.Geometry.Point3d as pt
import Rhino.Geometry.Curve as crv
import Rhino.Geometry.Vector3d as v
import Rhino.Geometry.Plane as plane

a = []

edges = b.Curves3D

bottomEdges = [edges[0],edges[1],edges[2],edges[3]]
topEdges = [edges[4],edges[5],edges[6],edges[7]]
leftEdges = [edges[3],edges[8],edges[7],edges[11]]
rightEdges = [edges[1],edges[10],edges[5],edges[9]]
backEdges = [edges[2],edges[10],edges[6],edges[11]]
frontEdges = [edges[0],edges[9],edges[4],edges[8]]

def getDivPts(edge, divisions):
    return crv.DivideByCount(edge, divisions, False)

def makeBottom(edgeList, dividers):
    #direction: 1 for bottom, -1 for top 
    t0 = edgeList[0].Domain[0]
    t1 = edgeList[0].Domain[1]
    vU = r.Geometry.Vector3d(0,backThickness+.5,0)
    vD = r.Geometry.Vector3d(0,-backThickness-.5,0)
    vL = r.Geometry.Vector3d(-mortiseDepth,0,0)
    vR = r.Geometry.Vector3d(mortiseDepth,0,0)
    vZ = r.Geometry.Vector3d(0,0,tenonThickness)
    ptA0 = edgeList[0].PointAt(t0+caseThickness)
    ptA1 = pt.Add(ptA0,vU)
    ptA2 = pt.Add(ptA1,vL)
    ptA3 = pt.Add(ptA0,vZ)
    ptB0 = edgeList[0].PointAt(t1-caseThickness)
    ptB1 = pt.Add(ptB0,vU)
    ptB2 = pt.Add(ptB1,vR)
    ptB3 = pt.Add(ptB0,vZ)
    ptC0 = edgeList[2].PointAt(t0+caseThickness)
    ptC1 = pt.Add(ptC0,vD)
    ptC2 = pt.Add(ptC1,vR)
    ptC3 = pt.Add(ptC0,vZ)
    ptD0 = edgeList[2].PointAt(t1-caseThickness)
    ptD1 = pt.Add(ptD0,vD)
    ptD2 = pt.Add(ptD1,vL)
    ptD3 = pt.Add(ptD0,vZ)
    divTs = crv.DivideByCount(edgeList[0], divisions+1, False)
    divisionMortises = []
    for t in divTs:
        divPtA = edgeList[0].PointAt(t+caseThickness-tenonThickness)
        divPtB = edgeList[2].PointAt(edgeList[2].ClosestPoint(divPtA)[1])
        divPtA = pt.Add(divPtA,vU)
        divPtB = pt.Add(divPtB,vD)
        mortise = r.Geometry.PolylineCurve([divPtA,divPtB])
        divisionMortises.append(mortise)
    tenonRight = r.Geometry.PolylineCurve([ptC3,ptB3])
    tenonLeft = r.Geometry.PolylineCurve([ptA3,ptD3])
    bottomPts = [ptA0,ptB0,ptB1,ptB2,ptC2,ptC1,ptC0,ptD0,ptD1,ptD2,ptA2,ptA1,ptA0]
    bottomOutline = r.Geometry.PolylineCurve(bottomPts)
    return [[bottomOutline, tenonRight, tenonLeft], divisionMortises]


def makeSide(edgeList, direction):
    #direction: 1 for left side, -1 for right side
    t0 = edgeList[0].Domain[0]
    t1 = edgeList[0].Domain[1]
    vI = r.Geometry.Vector3d(direction*(caseThickness-mortiseDepth),0,0) #inside
    vIR = r.Geometry.Vector3d(direction*.25,0,0) #inside Rabbet
    vU = r.Geometry.Vector3d(0,0,caseThickness-tenonThickness)
    vD = r.Geometry.Vector3d(0,0,tenonThickness-caseThickness)
    ptA = edgeList[0].PointAt(t0+backThickness+.5)
    ptA = pt.Add(ptA,vU)
    ptA = pt.Add(ptA,vI)
    ptA1 = edgeList[0].PointAt(t1-backThickness)
    ptA1 = pt.Add(ptA1,vU)
    ptA1 = pt.Add(ptA1,vIR)
    ptB = edgeList[0].PointAt(t1-backThickness-.5)
    ptB = pt.Add(ptB,vU)
    ptB = pt.Add(ptB,vI)
    ptB1 = edgeList[0].PointAt(t0+backThickness)
    ptB1 = pt.Add(ptB1,vU)
    ptB1 = pt.Add(ptB1,vIR)
    ptC = edgeList[2].PointAt(t0+backThickness+.5)
    ptC = pt.Add(ptC,vD)
    ptC = pt.Add(ptC,vI)
    ptC1 = edgeList[2].PointAt(t0+backThickness)
    ptC1 = pt.Add(ptC1,vD)
    ptC1 = pt.Add(ptC1,vIR)
    ptD = edgeList[2].PointAt(t1-backThickness-.5)
    ptD = pt.Add(ptD,vD)
    ptD = pt.Add(ptD,vI)
    ptD1 = edgeList[2].PointAt(t1-backThickness)
    ptD1 = pt.Add(ptD1,vD)
    ptD1 = pt.Add(ptD1,vIR)
    mortiseBottom = r.Geometry.PolylineCurve([ptA,ptB])
    mortiseTop = r.Geometry.PolylineCurve([ptD,ptC])
    pegPts = pegHoles(edgeList)
    if direction < 0:
        backRabbet = r.Geometry.PolylineCurve([ptA1,ptD1])
    else:
        backRabbet = r.Geometry.PolylineCurve([ptC1,ptB1])
    sideOutline = r.Geometry.Curve.JoinCurves(edgeList)
    return [sideOutline[0], mortiseBottom, mortiseTop, backRabbet, pegPts]

def makeBack(edgeList):
    t0 = edgeList[0].Domain[0]
    t1 = edgeList[0].Domain[1]
    vU = r.Geometry.Vector3d(0,0,caseThickness)
    vD = r.Geometry.Vector3d(0,0,-caseThickness)
    ptA = edgeList[0].PointAt(t0+.25)
    ptA = pt.Add(ptA,vU)
    ptB = edgeList[0].PointAt(t1-.25)
    ptB = pt.Add(ptB,vU)
    ptC = edgeList[2].PointAt(t1-.25)
    ptC = pt.Add(ptC,vD)
    ptD = edgeList[2].PointAt(t0+.25)
    ptD = pt.Add(ptD,vD)
    backOutline = r.Geometry.PolylineCurve([ptA,ptB,ptC,ptD,ptA])
    return backOutline
    
def makeDivider(edgeList):
    t0 = edgeList[0].Domain[0]
    t1 = edgeList[0].Domain[1]
    vR = r.Geometry.Vector3d(0,.5,0) 
    vRR = r.Geometry.Vector3d(0,backThickness+.5,0)
    vL = r.Geometry.Vector3d(0,-.5,0) 
    vLL = r.Geometry.Vector3d(0,-.5,0)  
    vU = r.Geometry.Vector3d(0,0,.25)
    vUU = r.Geometry.Vector3d(0,0,.5)
    vD = r.Geometry.Vector3d(0,0,-.25)
    vDD = r.Geometry.Vector3d(0,0,-.5)
    ptA = edgeList[0].PointAt(t0+backThickness+.5)
    ptA0 = pt.Add(ptA,vU)
    ptA1 = pt.Add(ptA0,vUU)
    ptA2 = pt.Add(ptA1,vR)
    ptB = edgeList[2].PointAt(t0+backThickness+.5)
    ptB3 = pt.Add(ptB,vD)
    ptB2 = pt.Add(ptB3,vDD)
    ptB1 = pt.Add(ptB2, vR)
    ptC = edgeList[2].PointAt(t1)
    ptC3 = pt.Add(ptC,vDD)
    ptC3 = pt.Add(ptC3, vD)
    ptC2 = pt.Add(ptC3, vRR)
    ptC1 = pt.Add(ptC2, vUU)
    ptD = edgeList[0].PointAt(t1)
    ptD0 = pt.Add(ptD, vUU)
    ptD0 = pt.Add(ptD0,vU)
    ptD1 = pt.Add(ptD0, vRR)
    ptD2 = pt.Add(ptD1, vDD)
    dividerOutline = r.Geometry.PolylineCurve([ptA0,ptA1,ptA2,ptB1, ptB2,ptB3,ptC1, ptC2, ptC3, ptD0, ptD1, ptD2, ptA0])
    return dividerOutline

def pegHoles(edgeList):
    t0 = edgeList[1].Domain[0]
    t1 = edgeList[1].Domain[1]
    pt0 = edgeList[1].PointAt(t0+2)
    pt1 = edgeList[1].PointAt(t1-2)
    plane0 = plane(edgeList[0].PointAtStart, v.YAxis)
    plane1 = plane(edgeList[0].PointAt(t0+2), v.YAxis)
    plane2 = plane(edgeList[0].PointAt(t1-2), v.YAxis)
    x1 = r.Geometry.Transform.PlaneToPlane(plane1,plane0)
    x2 = r.Geometry.Transform.PlaneToPlane(plane2, plane1)
    divLine = r.Geometry.PolylineCurve([pt0,pt1])
    tArray = divLine.DivideByLength(2, False)
    ptArray = []
    for t in tArray:
        ptArray.append(divLine.PointAt(t))
    frontPts = x1.TransformList(ptArray)
    backPts = x2.TransformList(frontPts)
    pegPts = []
    for point in frontPts:
        pegPts.append(point)
    for point in backPts:
        pegPts.append(point)
    return pegPts

    
    
    
    

#a = makeBottom(bottomEdges)
#a = makeSide(leftEdges)

def flattenLists(lists):
    newList = []
    for list in lists:
        #print type(list)
        if type(list) == list:
            for item in list:
                newList.append(item)
        else:
            newList.append(list)
    #print newList
bottom = []
top = []

bottomLists = makeBottom(bottomEdges, divisions)
bottom = flattenLists(bottomLists)
topLists = makeBottom(topEdges, divisions)
top = flattenLists(topLists)
leftLists = makeSide(leftEdges, 1)
left = flattenLists(leftLists)
right = makeSide(rightEdges, -1)
back = makeBack(backEdges)
dividers = makeDivider(leftEdges)
#dividers = pegHoles(leftEdges)
# ---------- end python ----------
mat_tenonthickness = RemoteSender(list_7)
mat_toprailwidth = RemoteSender("6")
mat_shoulderwidth = RemoteSender("1")
mat_casethickness = RemoteSender(list_2)
mat_tenondepth = RemoteSender(list_8)
mat_backthickness = RemoteSender(list)
col = Colour(RGBA(150, 0, 0, 111))
crv = Curve(python.bottom)
crv_2 = Curve([python.left, python.right])
crv_3 = Curve(python.back)
crvdir = CurveDirectionDisplay(Curves=crv, Color=col, Size=20)
group = Group(Objects=crv)
group_2 = Group(Objects=crv_2)
group_3 = Group(Objects=crv_3)
boxfaces = PythonScript()  # -> out, top, bottom, front, back, left, right, a; inputs box: Brep
# ---------- boxfaces: Python ----------
import Rhino as r
a = []

for face in box.Faces:
    #normal = face.TryGetPlane(0)[1].Normal
    u = face.Domain(0)
    v = face.Domain(1)
    normal = face.NormalAt(u[0],v[0])
    a.append(face.DuplicateFace(face))
    if (normal.VectorAngle(normal,(r.Geometry.Vector3d(0,-1,0)))==0):
            front = face.DuplicateFace(face)
    elif (normal.VectorAngle(normal,(r.Geometry.Vector3d(1,0,0)))==0):
            right = face.DuplicateFace(face)
    elif (normal.VectorAngle(normal,(r.Geometry.Vector3d(0,1,0)))==0):
            back = face.DuplicateFace(face)
    elif (normal.VectorAngle(normal,(r.Geometry.Vector3d(-1,0,0)))==0):
            left = face.DuplicateFace(face)
    elif (normal.VectorAngle(normal,(r.Geometry.Vector3d(0,0,-1)))==0):
            bottom = face.DuplicateFace(face)
    elif (normal.VectorAngle(normal,(r.Geometry.Vector3d(0,0,1)))==0):
            top = face.DuplicateFace(face)
    else:
        print("Non-orthoganal face detected")
        print(normal.VectorAngle(normal,(r.Geometry.Vector3d(-1,0,0))))
# ---------- end boxfaces ----------
